# Dynamo graph run.dyn (Dynamo 3.3.0.6316)

code_block = CodeBlock { "Walls"; }
byName = Category.ByName(name=code_block)
all_elements_of_category = ElementsOfCategory(Category=byName)
delete = Element.Delete(element=all_elements_of_category)  # graph output
